test file "myEncoderLibTest"

suite "EncoderTests"

  case "SingleZerosChannel" [baseline]
    model MidSideLibrary_Solution, harness MidSideLibrary_Solution_EncoderTestSingleZerosChannel (for MidSideLibrary_Solution/Encoder)

  case "SimilarChannels" [baseline]
    model MidSideLibrary_Solution, harness MidSideLibrary_Solution_EncoderTestSimilarChannels (for MidSideLibrary_Solution/Encoder)

  case "SignalDimensions" [simulation]
    model MidSideLibrary_Solution, harness MidSideLibrary_Solution_EncoderTestDimensions (for MidSideLibrary_Solution/Encoder)

suite "DecoderTests"

  case "SingleZerosChannel" [simulation]
    model MidSideLibrary_Solution, harness MidSideLibrary_Solution_DecoderTestSingleZerosChannel (for MidSideLibrary_Solution/Decoder)

  case "SimilarChannels" [baseline]
    model MidSideLibrary_Solution, harness MidSideLibrary_Solution_DecoderTestSimilarChannels (for MidSideLibrary_Solution/Decoder)

  case "SignalDimensions" [baseline]
    model MidSideLibrary_Solution, harness MidSideLibrary_Solution_DecoderTestDimensions (for MidSideLibrary_Solution/Decoder)