test file "SmokeTest_Solution"

suite "SmokeTestSuite"

  case "SmokeTest" [baseline]
    model MidSideProcessor_Solution, start time 0, stop time 2
    logged signals "Signal Set 1": stereoSndOut, stereoSndIn
    post-load callback:
      set_param('MidSideProcessor_Solution/Width', 'Value', '1');
      set_param('MidSideProcessor_Solution/Audio Output', 'Commented', 'on');
    baseline "smokeTestData_Solution.mat"
      stereoSndOut
      stereoSndIn
      Width:Value